# Grasshopper definition annotation_test.gh (Grasshopper 1.0.7)
# plug-ins: GrasshopperPRT

# ---- group: numbers
number_slider = Slider(2, range=0..4)
number_slider_2 = Slider(5, range=0..10)
num = Number()

# ---- group: arrays
toggle = BooleanToggle(False)
txt = Text()
num_2 = Number()

# ----
path = FilePath("C:\Users\lor11212\Documents\Rhino\rhino-plugin-prototype\TestCases\annotations_test.rpk")
rec = Rectangle({Plane=PlaneXY(2, 13, 0), Size=Domain2(u=-13..13, v=-19..19)})
ghprt = GrasshopperPRT(
    PathToRPK=path,
    InitialShapes=rec,
    DefaultArray1d=num_2,
    DefaultArray1dBool=toggle,
    DefaultArray1dString=txt,
    DefaultVariant=number_slider,
    DefaultSetBack=number_slider_2,
    DefaultPyramidHeight=num)  # -> GeneratedShapes, Materials, Reports
