# Grasshopper definition array_attributes_test.gh (Grasshopper 1.0.7)
# plug-ins: GrasshopperPRT

series = Series(Start=10, Step=1, Count=10)
txt = Text(["Test1", "Test2", "Salut", "Bonjour", "Test5"])
path = FilePath("C:\Users\lor11212\Documents\Rhino\rhino-plugin-prototype\TestCases\array_attributes_test.rpk")
rec = Rectangle({Plane=PlaneXY(7, 5.5, 0), Size=Domain2(u=-21..21, v=-39.5..39.5)})
bool = Boolean([True, False, False, True])
ghprt = GrasshopperPRT(PathToRPK=path, InitialShapes=rec, DefaultArray1d=series, DefaultArray1dBool=bool, DefaultArray1dString=txt)  # -> GeneratedShapes, Reports
