# Grasshopper definition basic_material_test.gh (Grasshopper 1.0.7)
# plug-ins: GrasshopperPRT

path = FilePath("C:\Users\lor11212\Documents\Rhino\rhino-plugin-prototype\TestCases\basic_material_6_twoMaterials.rpk")
rec = Rectangle({Plane=PlaneXY(2.5, -0.5, 0), Size=Domain2(u=-7.5..7.5, v=-5.5..5.5)})
ghprt = GrasshopperPRT(PathToRPK=path, InitialShapes=rec)  # -> GeneratedShapes, Materials
preview = CustomPreview(Geometry=ghprt.GeneratedShapes, Material=ghprt.Materials)
