# Grasshopper definition candler_building.gh (Grasshopper 1.0.7)
# plug-ins: GrasshopperPRT

path = FilePath("C:\Users\lor11212\Documents\Rhino\rhino-plugin-prototype\TestCases\Candler_Building.rpk")
rec = Rectangle({Plane=PlaneXY(6, 17.5, 0), Size=Domain2(u=-17..17, v=-25.5..25.5)})
ghprt = GrasshopperPRT(PathToRPK=path, InitialShapes=rec, DefaultBuildingHeight=Slider(30, range=0..50))  # -> GeneratedShapes, Materials, Reports
preview = CustomPreview(Geometry=ghprt.GeneratedShapes, Material=ghprt.Materials)
