# Grasshopper definition default_example.gh (Grasshopper 1.0.7)
# plug-ins: GrasshopperPRT

# ---- group: Choose a rule package: Right-clic -> Select one existing file
path = FilePath()

# ----
rec = Rectangle({Plane=PlaneXY(6, 17.5, 0), Size=Domain2(u=-17..17, v=-25.5..25.5)})
ghprt = GrasshopperPRT(PathToRPK=path, InitialShapes=rec)  # -> GeneratedShapes, Materials, Reports
preview = CustomPreview(Geometry=ghprt.GeneratedShapes, Material=ghprt.Materials)
