# Grasshopper definition multiple_init_rectangles.gh (Grasshopper 1.0.7)
# plug-ins: GrasshopperPRT

path = FilePath("C:\Users\lor11212\Documents\Rhino\rhino-plugin-prototype\extrusion_rule.rpk")
rec = Rectangle([{Plane=PlaneXY(18.5, 7, 0), Size=Domain2(u=-6.5..6.5, v=-8..8)}, {Plane=PlaneXY(-1.5, 21.5, 0), Size=Domain2(u=-5.5..5.5, v=-6.5..6.5)}, {Plane=PlaneXY(-18.5, 10, 0), Size=Domain2(u=-5.5..5.5, v=-7..7)}, {Plane=PlaneXY(32, 40, 0), Size=Domain2(u=-7..7, v=-9..9)}, {Plane=PlaneXY(-1.5, 43, 0), Size=Domain2(u=-8.5..8.5, v=-7..7)}, {Plane=PlaneXY(-36, -3.5, 0), Size=Domain2(u=-5..5, v=-3.5..3.5)}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])
ghprt = GrasshopperPRT(PathToRPK=path, InitialShapes=rec, DefaultHeight=Slider(55, range=0..100))
panel = Panel(ghprt)
