# Grasshopper definition parthenon.gh (Grasshopper 1.0.7)
# plug-ins: GrasshopperPRT

rec = Rectangle({Plane=PlaneXY(3, 13.5, 0), Size=Domain2(u=-13..13, v=-17.5..17.5)})
path = FilePath("C:\Users\lor11212\Documents\Rhino\rhino-plugin-prototype\TestCases\Candler_Building.rpk")
ghprt = GrasshopperPRT(PathToRPK=path, InitialShapes=rec)  # -> GeneratedShapes, Materials, Reports
preview = CustomPreview(Geometry=ghprt.GeneratedShapes, Material=ghprt.Materials)
