# Grasshopper definition parthenon_test.gh (Grasshopper 1.0.7)
# plug-ins: GrasshopperPRT

number_slider = Slider(3, range=0..10)
panel = Panel("High")
srf = Surface(<surface referenced from the Rhino model>)
path = FilePath("C:\Users\lor11212\Documents\Rhino\rhino-plugin-prototype\TestCases\parthenon.rpk")
toggle = BooleanToggle(True)
srf_2 = Surface(<surface referenced from the Rhino model>)
path_2 = FilePath("C:\Users\lor11212\Documents\Rhino\rhino-plugin-prototype\TestCases\complexpatterns_01.rpk")
num = Number(30)
ghprt = GrasshopperPRT(PathToRPK=path, InitialShapes=srf)
ghprt_2 = GrasshopperPRT(PathToRPK=path_2, InitialShapes=srf_2)
panel_2 = Panel(ghprt)
srf_3 = Surface(<surface referenced from the Rhino model>)
path_3 = FilePath("C:\Users\lor11212\Documents\Rhino\rhino-plugin-prototype\TestCases\Candler_Building.rpk")
ghprt_3 = GrasshopperPRT(PathToRPK=path_3, InitialShapes=srf_3)
