# Grasshopper definition performance_test_128_init_shapes.gh (Grasshopper 1.0.7)
# plug-ins: GrasshopperPRT

number_slider = Slider(0.25, range=0..1)
panel = Panel("128 initial shapes")
path = FilePath("C:\Users\lor11212\Documents\Rhino\rhino-plugin-prototype\TestCases\extrusion_rule.rpk")
srf = Surface([<surface referenced from the Rhino model> x128])
ghprt = GrasshopperPRT(PathToRPK=path, InitialShapes=srf, DefaultHeight=Slider(42, range=0..100))
