# Grasshopper definition report01_test.gh (Grasshopper 1.0.7)
# plug-ins: GrasshopperPRT

path = FilePath("C:\Users\lor11212\Documents\Rhino\rhino-plugin-prototype\TestCases\reporting_04.rpk")
crv = Curve(<curve referenced from the Rhino model>)
rec = Rectangle([{Plane=PlaneXY(40, -29.5, 0), Size=Domain2(u=-11..11, v=-13.5..13.5)}, {Plane=PlaneXY(41.5, 17.5, 0), Size=Domain2(u=-6.5..6.5, v=-19.5..19.5)}, {Plane=PlaneXY(18, 52.5, 0), Size=Domain2(u=-6..6, v=-13.5..13.5)}, {Plane=PlaneXY(0, -22.5, 0), Size=Domain2(u=-9..9, v=-13.5..13.5)}, {Plane=PlaneXY(-4.5, 18, 0), Size=Domain2(u=-12.5..12.5, v=-17..17)}, {Plane=PlaneXY(-47, 27.5, 0), Size=Domain2(u=-12..12, v=-18.5..18.5)}, {Plane=PlaneXY(-31.5, -27, 0), Size=Domain2(u=-8.5..8.5, v=-19..19)}])
crv_2 = Curve(<curve referenced from the Rhino model>)
rec_2 = Rectangle({Plane=PlaneXY(54.5, -24.5, 0), Size=Domain2(u=-5.5..5.5, v=-21.5..21.5)})
path_2 = FilePath("C:\Users\lor11212\Documents\Rhino\rhino-plugin-prototype\TestCases\reporting_03.rpk")
ghprt = GrasshopperPRT(PathToRPK=path_2, InitialShapes=[crv, rec, crv_2, rec_2])  # -> GeneratedShapes, Reports
panel = Panel(ghprt.Reports)
panel_2 = Panel(ghprt.GeneratedShapes)
panel_3 = Panel("11")
panel_4 = Panel("""Floor Count_max
Floor Count_min
FAR_sum
GFA.Retail_min
GFA.Residential_avg
Area.IsGreenspace_avg
Floor Name_sum""")
domain = Domain(Domain(1, 4))
cga_reports_display = GrasshopperPRTReports(Meshes=ghprt.GeneratedShapes, Reports=ghprt.Reports, ShapeIDFilter=domain, ReportKeyFilter=panel_4)  # -> ReportsLocation, ReportsDisplay, Reports
colour = ColourPicker(PickedColour=RGB(41, 242, 195))
reports_outputs = GrasshopperPRTReportsOutput(Reports=cga_reports_display.Reports)  # -> ReportName, ShapeID, ReportValue
tag = TextTag3D(
    Location=cga_reports_display.ReportsLocation,
    Text=cga_reports_display.ReportsDisplay,
    Size=Slider(1, range=0..10),
    Colour=colour,
    Justification=7)
panel_5 = Panel(reports_outputs.ReportName)
panel_6 = Panel(reports_outputs.ShapeID)
panel_7 = Panel(reports_outputs.ReportValue)
