# Grasshopper definition report02_test.gh (Grasshopper 1.0.7)
# plug-ins: GrasshopperPRT

rec = Rectangle([{Plane=PlaneXY(-35, 46, 0), Size=Domain2(u=-16..16, v=-14..14)}, {Plane=PlaneXY(14.5, 42, 0), Size=Domain2(u=-13.5..13.5, v=-17..17)}, {Plane=PlaneXY(23.5, 3, 0), Size=Domain2(u=-5.5..5.5, v=-11..11)}, {Plane=PlaneXY(64, 29, 0), Size=Domain2(u=-12..12, v=-31..31)}, {Plane=PlaneXY(-37.5, -46, 0), Size=Domain2(u=-9.5..9.5, v=-11..11)}, {Plane=PlaneXY(-31, -0.5, 0), Size=Domain2(u=-22..22, v=-5.5..5.5)}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])
path = FilePath("C:\Users\lor11212\Documents\Rhino\rhino-plugin-prototype\TestCases\reporting_04.rpk")
ghprt = GrasshopperPRT(PathToRPK=path, InitialShapes=rec)  # -> GeneratedShapes, Materials, Reports
domain = Domain([Domain(0, 1), Domain(5, 10)])
cga_reports_display = GrasshopperPRTReports(Meshes=ghprt.GeneratedShapes, Reports=ghprt.Reports, ShapeIDFilter=domain)  # -> ReportsLocation, ReportsDisplay, Reports
colour = ColourPicker(PickedColour=RGB(255, 255, 255))
tag = TextTag3D(
    Location=cga_reports_display.ReportsLocation,
    Text=cga_reports_display.ReportsDisplay,
    Size=1,
    Colour=colour,
    Justification=7)
reports_outputs = GrasshopperPRTReportsOutput(Reports=cga_reports_display.Reports)  # -> ReportName, ShapeID, ReportValue
panel = Panel(reports_outputs.ShapeID)
panel_2 = Panel(reports_outputs.ReportName)
panel_3 = Panel(reports_outputs.ReportValue)
