# Grasshopper definition single_letter.gh (Grasshopper 1.0.7)
# plug-ins: GrasshopperPRT

rec = Rectangle({Plane=PlaneXY(0.5, 0.5, 0), Size=Domain2(u=-0.5..0.5, v=-0.5..0.5)})
path = FilePath("C:\Users\lor11212\Documents\Rhino\rhino-plugin-prototype\TestCases\single_letter.rpk")
ghprt = GrasshopperPRT(PathToRPK=path, InitialShapes=rec)  # -> GeneratedShapes, Materials, Reports
preview = CustomPreview(Geometry=ghprt.GeneratedShapes, Material=ghprt.Materials)
