# Grasshopper definition texture_material_test.gh (Grasshopper 1.0.7)
# plug-ins: GrasshopperPRT

path = FilePath("C:\Users\lor11212\Documents\Rhino\rhino-plugin-prototype\TestCases\basic_material_6_twoMaterials.rpk")
rec = Rectangle({Plane=PlaneXY(13.5, 34.5, 0), Size=Domain2(u=-11.5..11.5, v=-21.5..21.5)})
ghprt = GrasshopperPRT(PathToRPK=path, InitialShapes=rec)  # -> GeneratedShapes, Materials
preview = CustomPreview(Geometry=ghprt.GeneratedShapes, Material=ghprt.Materials)
