# Grasshopper definition various_init_shape_types.gh (Grasshopper 1.0.7)
# plug-ins: GrasshopperPRT

box = Box({Plane=PlaneXY(-30, -40, 0), X=Domain(0, 10), Y=Domain(0, 10), Z=Domain(0, 12)})
crv = Curve(<curve referenced from the Rhino model>)
rec = Rectangle([{Plane=PlaneXY(21, -36.5, 0), Size=Domain2(u=-4..4, v=-5.5..5.5)}, {Plane=PlaneXY(34, -35.5, 0), Size=Domain2(u=-4..4, v=-5.5..5.5)}])
srf = Surface([<surface referenced from the Rhino model> x5])
mesh = Mesh(<mesh referenced from the Rhino model>)
path = FilePath("C:\Users\lor11212\Documents\Rhino\rhino-plugin-prototype\extrusion_rule.rpk")
X = UnitX(Factor=Slider(123.2, range=0..200))
brep = Brep(srf)
move = Move(Geometry=brep, Motion=X)  # -> Geometry, Transform
ghprt = GrasshopperPRT(PathToRPK=path, InitialShapes=[rec, srf, mesh, move.Geometry, box, crv], DefaultHeight=Slider(26, range=0..100))
panel = Panel(ghprt)
